vi "Voltage - Continuous Input.gvi"   [LabVIEW NXG 4.0.0]
panel controls:
  "Stop": bool  # Stop stops the acquisition. It is recommended to stop your VI through this stop button so the DAQmx task can be properly cleared.
  "YAML File Path": path
panel indicators:
  "error out": error
  "Actual Sample Rates": f64[]
  "Graph": waveform<f64>[]
  "Graph_2": waveform<f64>[]
  "Graph_3": waveform<f64>[]
uses:
  YAML Config Reader::Load YAML Configuration.gvi
  YAML Config Reader::Get Configuration Count.gvi
  YAML Config Reader::Get Sample Rate Hz.gvi
  YAML Config Reader::Get Minimum Voltage.gvi
  YAML Config Reader::Get Maximum Voltage.gvi
  YAML Config Reader::Get Hardware Channels.gvi
  YAML Config Reader::Unload YAML Configuration.gvi
  NI::DAQmx::Internal::DAQmx Create Channel (AI-Voltage-Basic).gvi
  NI::DAQmx::Internal::DAQmx Timing (Sample Clock).gvi
  NI::DAQmx::Internal::DAQmx Start Task.gvi
  NI::DAQmx::Internal::DAQmx Read (Analog 1D Wfm NChan NSamp).gvi
  NI::DAQmx::Internal::DAQmx Stop Task.gvi
  NI::DAQmx::Internal::DAQmx Clear Task.gvi
diagram:
  Path To String(path=$"YAML File Path") -> (string=w1)
  call "Load YAML Configuration.gvi"(YAML Config File Path=w1) -> (YAML Handle Out=w2, Error Out=w3)
  call "Get Configuration Count.gvi"(YAML Handle In=w2, Error In=w3) -> (YAML Handle Out=w4, Count=w5, Error Out=w6)
  To Signed 32 Bit Integer(number=w5) -> w7
  s1 = w6  # shift register
  s2 = w4  # shift register
  for (N = w7) (iteration -> i1) {
    To Unsigned 32 Bit Integer(number=i1) -> w12
    call "Get Sample Rate Hz.gvi"(YAML Handle In=s2, Index=w12, Error In=s1) -> (YAML Handle Out=w13, Sample Rate (Hz)=w14, Error Out=w15)
    # Read configuration details from YAML file
    To Double Precision Float(number=w14) -> w16
    call "Get Minimum Voltage.gvi"(YAML Handle In=w13, Index=w12, Error In=w15) -> (YAML Handle Out=w17, Minimum Voltage=w18, Error Out=w19)
    To Double Precision Float(number=w18) -> w20
    call "Get Maximum Voltage.gvi"(YAML Handle In=w17, Index=w12, Error In=w19) -> (YAML Handle Out=w21, Maximum Voltage=w22, Error Out=w23)
    To Double Precision Float(number=w22) -> w24
    call "Get Hardware Channels.gvi"(YAML Handle In=w21, Index=w12, Error In=w23) -> (YAML Handle Out=w25, Hardware Channels=w26, Error Out=w27)
    append w16 to w8
    append w20 to w9
    append w24 to w10
    append w26 to w11
    next s1 = w27
    next s2 = w25
  }
  call "Unload YAML Configuration.gvi"(YAML Handle In=s2, Error In=s1) -> (Error Out=w28)
  for {
    w29 = each element of w8
    w30 = each element of w11
    w31 = each element of w10
    w32 = each element of w9
    Build Cluster(w31, w32) -> w35
    call "DAQmx Create Channel (AI-Voltage-Basic).gvi"(error in=w28, physical channels=w30, measurement range=w35) -> (task out=w36, error out=w37)
    # Configure DAQmx tasks
    call "DAQmx Timing (Sample Clock).gvi"(task in=w36, error in=w37, rate=w29, source="OnboardClock", sample mode="Continuous Samples"(10123), samples per channel=100) -> (task out=w38, error out=w39)
    Property Node(instance in=w38, error in=w39) -> ("SampClk_Rate_1344"=w40, error out=w41, instance out=w42)
    append w42 to w33
    append w40 to w34
  }
  Array Index(array=w33) -> (out0[_]=w43, out1[_]=w44, out2[_]=w45)
  call "DAQmx Start Task.gvi"(task in=w43, error in=w41) -> (task out=w46, error out=w47)
  # Read from hardware
  while {
    call "DAQmx Read (Analog 1D Wfm NChan NSamp).gvi"(task in=w46, error in=w47, number of samples per channel=100) -> (task out=w48, error out=w49, data=w50)
    $Graph <- w50
    Property Node(instance in=w49) -> ("status"=w51)
    Logical Or(w51, $Stop) -> w52
    stop if w52
  }
  call "DAQmx Stop Task.gvi"(task in=w48, error in=w49) -> (task out=w53, error out=w54)
  call "DAQmx Clear Task.gvi"(task in=w53, error in=w54) -> (error out=w55)
  call "DAQmx Start Task.gvi"(task in=w44, error in=w41) -> (task out=w56, error out=w57)
  while {
    call "DAQmx Read (Analog 1D Wfm NChan NSamp).gvi"(task in=w56, error in=w57, number of samples per channel=100) -> (task out=w58, error out=w59, data=w60)
    $Graph_2 <- w60
    Property Node(instance in=w59) -> ("status"=w61)
    Logical Or(w61, $Stop) -> w62
    stop if w62
  }
  call "DAQmx Stop Task.gvi"(task in=w58, error in=w59) -> (task out=w63, error out=w64)
  call "DAQmx Clear Task.gvi"(task in=w63, error in=w64) -> (error out=w65)
  call "DAQmx Start Task.gvi"(task in=w45, error in=w41) -> (task out=w66, error out=w67)
  while {
    call "DAQmx Read (Analog 1D Wfm NChan NSamp).gvi"(task in=w66, error in=w67, number of samples per channel=100) -> (task out=w68, error out=w69, data=w70)
    $Graph_3 <- w70
    Property Node(instance in=w69) -> ("status"=w71)
    Logical Or(w71, $Stop) -> w72
    stop if w72
  }
  call "DAQmx Stop Task.gvi"(task in=w68, error in=w69) -> (task out=w73, error out=w74)
  call "DAQmx Clear Task.gvi"(task in=w73, error in=w74) -> (error out=w75)
  Merge Errors(w55, w65, w75) -> (error out=w76)
  $"error out" <- w76
  $"Actual Sample Rates" <- w34
